# Grasshopper definition example.gh (Grasshopper 1.0.7)
# plug-ins: baues-toolbox Info, THERB-GH

# ----
# 成功ケース
brep = Brep([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])
srf = Surface(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)

brep_2 = Brep([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])
srf_2 = Surface([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])

brep_3 = Brep([<brep referenced from the Rhino model> x5])
srf_3 = Surface(<surface referenced from the Rhino model>)

srf_4 = Surface([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])
brep_4 = Brep([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])

brep_5 = Brep([<brep referenced from the Rhino model> x15])
srf_5 = Surface([<surface referenced from the Rhino model> x3])

brep_6 = Brep([<brep referenced from the Rhino model> x3])
srf_6 = Surface(<surface referenced from the Rhino model>)

srf_7 = Surface(<surface referenced from the Rhino model>)
# 失敗ケース
brep_7 = Brep([<brep referenced from the Rhino model> x4])

brep_8 = Brep([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])
srf_8 = Surface([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])

readconstruction = ReadConstruction(Run=Toggle(True))
therb = THERB(Boxes=brep_8, Windows=srf_8, Tolerance=0.1)  # -> Therb, Test
exportw = ExportW(Construction=readconstruction)

number_slider = Slider(0.1, range=0..0.1)
windows_split = Surface([<surface referenced from the Rhino model> x3])
# step1. ジオメトリ、条件入力
rooms_split = Brep([<brep referenced from the Rhino model> x20])

panel = Panel(readconstruction)
# 北の方角を指定
vec = Vector()
# タスク13.fiterFaceByPropertyを実装
decompose = Decompose(Therb=therb.Therb)  # -> Rooms, Faces, Windows, Overhangs
brep_9 = Brep([<brep referenced from the Rhino model> x3])
filterfacebyproperty = FilterFaceByProperty(Faces=decompose.Faces, Bc=0, SurfT=0, Direction=-1)  # -> TrueFace, FalseFace
item = ListItem(List=decompose.Rooms, Index=Slider(2, range=0..2), Wrap=True)
readroomproperty = ReadRoomProperty(Rooms=item)  # -> Id, Geometry, Volume
item_2 = ListItem(List=readconstruction, Index=Slider(0, range=0..15), Wrap=True)
readproperty = ReadProperty()
item_3 = ListItem(List=filterfacebyproperty.TrueFace, Index=Slider(0, range=0..15), Wrap=True)
readfaceproperty = ReadFaceProperty(Faces=filterfacebyproperty.TrueFace)  # -> RoomId, PartId, Surface, ElementType, Normal, CenterPt, Direction, ConstructionId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
updateconstruction = UpdateConstruction(Face=filterfacebyproperty.FalseFace, Construction=item_2)
readfaceproperty_2 = ReadFaceProperty(Faces=filterfacebyproperty.TrueFace)  # -> RoomId, PartId, Surface, ElementType, Normal, CenterPt, Direction, AdjacencyRoomId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
exportb = ExportB(Therb=therb.Therb)
exportr = ExportR(Therb=therb.Therb)
run_simulation = RunSimulation(Therb=therb.Therb, Name="TEST", Run=Toggle(False))
panel_2 = Panel(readfaceproperty.ConstructionId)
srf_9 = Surface(readfaceproperty_2.Surface)

# ----
# step2. 出力をチェック
b_datファイル書き出し = Panel(exportb)
w_datファイル書き出し = Panel(exportw)
r_datファイル書き出し = Panel(exportr)

# ----
# step03.
# サーバーにuploadする
# ための情報を入力
# step03-1. サーバーのドメイン入力
# (今のところ、ここは変える必要ないです）
# step03-2. プロジェクト名を入力
# step03-3. Trueにするとuploadして計算開始
panel_3 = Panel("http://localhost:5000/run")

uploadtherb = UploadTherb(Url=panel_3, ProjectName="demo2", Upload=Toggle(True))
# step04.
# サーバーからのresponseが表示されます。
# successとなっていれば、以下のurlをchrome
# で表示してください
# step05.
# 計算結果をPythonを利用してさらに分析することができます。
# 以下に分析例をまとめたJupyter Notebookを置いています。
# https://github.com/becat-oss/therb-notebook
panel_4 = Panel(uploadtherb)
